# Grasshopper definition main.gh (Grasshopper 1.0.8)
# plug-ins: RhinoCodePluginGH

# example 위치 : 숙명여대 근처
panel = Panel("example\37608089\N3L_F0010000.shp")
topotomesh = TopoToMesh(path=panel)  # -> geometry, M; disabled
shp_import = ShapefileImport(path="example\37608089\N3L_A0020000.shp")  # -> out, shape_type, geometry, fields, field_names, records; inputs path: tree, read_geometry: tree of Boolean, read_records: tree of Boolean, field_ids: tree, enc: tree; disabled; same code as shp_import
shp_import_2 = ShapefileImport(path="example\37608089\N3A_A0010000.shp")  # -> out, shape_type, geometry, fields, field_names, records; inputs path: tree, read_geometry: tree of Boolean, read_records: tree of Boolean, field_ids: tree, enc: tree; disabled; same code as shp_import
number_slider = Slider(0.1, range=0.1..0.5)  # disabled
centerlines = Geometry(flatten(shp_import.geometry))  # disabled
topomesh = Geometry(topotomesh.M)  # disabled
road_regions = Geometry(flatten(shp_import_2.geometry))  # disabled

# ---- group: PreviewContents -> 활성화
topomeshanalysis = TopoMeshAnalysis(geometry=topomesh)  # disabled

# ----
panel_2 = Panel(" 도로 5000개에 약 10초 , X13 기준")  # disabled
py3 = Python3Script(
    script=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,
    topo=topomesh,
    road_centerlines=centerlines,
    road_regions=road_regions,
    steep_percentage=number_slider)  # -> out, output, steep_roads; inputs topo: Mesh, road_centerlines: list of Curve, road_regions: list of Curve, steep_percentage: Double; disabled; unedited script template
geo = Geometry(py3.steep_roads)  # disabled
panel_3 = Panel(py3.output)  # disabled

# ==== cluster TopoToMesh
path = ClusterInput()
shp_import = ShapefileImport(path=path)  # -> out, shape_type, geometry, fields, field_names, records; inputs path: tree, read_geometry: tree of Boolean, read_records: tree of Boolean, field_ids: tree, enc: tree
# ---------- shp_import: Python ----------
# -*- coding: utf-8 -*-

# Source code available at https://github.com/hiteca

"""
Component to import geometry and data from ESRI Shapefile.

    Args:
        path: Path to .shp file
        read_geometry: [bool, optional] Toggle to read geometry.
                        Default - True.
        read_records: [bool, optional] Toggle to read data.
                        Default - True.
        field_ids: List of data column to read. 
                    Default - read all columns.
        enc: File encoding. 
                Default - utf-8
    Returns:
        shape_type: pyShp shape type (1 - point, 3 - polyline, 5 - polygon...). See full list at https://github.com/GeospatialPython/pyshp
        geometry: Imported geometry from shp. Each shape is in own branch
        fields: List of fields (format - "name|type|length")
        field_names: List of field names
        records: Data rows. Each row in own branch
"""
ghenv.Component.Name = "Shapefile Import"
ghenv.Component.NickName = 'Shp Import'
ghenv.Component.IconDisplayMode = ghenv.Component.IconDisplayMode.icon
ghenv.Component.Category = "Extra"
ghenv.Component.SubCategory = "Hiteca"
try: ghenv.Component.AdditionalHelpFromDocStrings = "2"
except: pass


import System
import clr
clr.AddReference("Grasshopper")
from Grasshopper.Kernel.Data import GH_Path
from Grasshopper import DataTree

import Grasshopper.Kernel as gh

we = gh.GH_RuntimeMessageLevel.Error
ww = gh.GH_RuntimeMessageLevel.Warning

try:
    import shapefile
except:
    message = "Python module 'pyshp' not found. Please download it and install to Rhino IronPython folder using manual at https://github.com/hiteca/ghshp"
    ghenv.Component.AddRuntimeMessage(we, message)
    message = "https://github.com/hiteca/ghshp#install-pyshp"
    ghenv.Component.AddRuntimeMessage(we, message)

import Rhino as rc

def list2branch(source_tree,data,item_index,data_path):
    _p = GH_Path(data_path).AppendElement(item_index)
    for i in range(len(data)):
        _data = data[i]
        if type(_data) == list:
            soruce_tree = v2branch(source_tree,_data,i,_p)
        else:
            source_tree.AddRange([_data],GH_Path(_p))
    return source_tree
    

def py_tree(source_tree, reverse=False, default=None):
    if not reverse:
        result = {}
        for i in range(len(source_tree.Branches)):
            d = source_tree.Branches[i]
            p = GH_Path(source_tree.Paths[i])
            
            result[p] = list(d)
        if len(result.keys())==0:
            result[GH_Path(0)] = [default]
    else:
        result = DataTree[System.Object]()
        for p in source_tree.keys():
            d = source_tree[p]
            _d = []
            for j in range(len(d)):
                data = d[j]
                if type(data) == list:
                    result = list2branch(result,data,j,p)
                else:
                    _d.append(data)
            if len(_d) > 0:
                result.AddRange(_d,p)
                
    return result

def repeat_latest(data,length):
    if len(data) > length:
        return data[:length]
    else:
        return data + ([data[-1]] * (length - len(data)))

def graft_tree(t):
    r = {}
    for k,v in t.items():
        for i in range(len(v)):
            r[GH_Path(k).AppendElement(i)] = [v[i]]
    return r
    
def longest_list(t_a,t_b):
    r_b = {}
    r_a = {}
    prev_a = t_a.items()[0][1]
    prev_b = t_b.items()[0][1]
    
    if len(t_a) >= len(t_b):
        keys = t_a.keys()
    else:
        keys = t_b.keys()

    keys = sorted(keys, key=lambda x: str(GH_Path(x)))

    for k in keys:
        try:
            branch_a = t_a[k]
            prev_a = t_a[k]
        except:
            branch_a = prev_a
        try:
            branch_b = t_b[k]
            prev_b = t_b[k]
        except:
            branch_b = prev_b
        max_len = max(len(branch_b),len(branch_a))
        if len(branch_b) >= len(branch_a):
            branch_a = repeat_latest(branch_a, len(branch_b))
        else:
            branch_b = repeat_latest(branch_b, len(branch_a))
        r_a[k] = branch_a
        r_b[k] = branch_b
        
    return(r_a,r_b)


shape_types = {
    "point" : [
        1, #POINT
        8, #MULTIPOINT
        11, #POINTZ
        18, #MULTIPOINTZ
        21, #POINTM
        28, #MULTIPOINTM
    ],
    "polyline": [
        3, #POLYLINE
        5, #POLYGON
        13, #POLYLINEZ
        15, #POLYGONZ
        23, #POLYLINEM
        25, #POLYGONM
        31, #MULTIPATCH
    ]
}

def find_type(t):
    for k in shape_types.keys():        
        if t in shape_types[k]:
            return k
            

def list2point(pt):
    pt = list(pt)
    if len(pt)==2:
        pt.append(0)
    return rc.Geometry.Point3d(pt[0],pt[1],pt[2])
    
def read_shapefile(file_path, read_data=True, read_geom=True, enc="utf-8"):
    result_geom = []
    result_fields = []
    result_field_names = []
    result_records = []
    if read_data or read_geom:
        sf = shapefile.Reader(file_path)
        sf_type = find_type(sf.shapeType)
        # вывод полей
        if read_data:
            shpfields = sf.fields
            shprecords = sf.records()
            f = 0
            if str(sf.fields[0][0]).startswith("DeletionFlag"):
                shpfields.pop(0) # remove DeletionFlag field

            for i in range(len(shpfields)):
                _shpfields = shpfields[i]
                _field = _shpfields[0]
                _field_type = _shpfields[1]
                _field_len = _shpfields[2]
                _field = _field.decode(enc, errors="replace")
                
                result_field_names.append(_field)
                field = "%s;%s;%d" % (_field,_field_type,_field_len)
                result_fields.append(field)
                
        #вывод полилиний и данных
        shapes = sf.shapes()
        

        for i in range(len(shapes)):
            path = GH_Path(i)

            #считывание геометрии
            if read_geom:
                shape = shapes[i]
                #разделение на части
    
                if sf_type == "point":
                    parts = shape.points
                    pt_list = []
                    for p in range(len(parts)):
                        pt = list(parts[p])
                        pt_list.append(list2point(pt))
                    result_geom.append(pt_list)
                else:
                    parts = shape.parts
                    parts2 = parts[:] # copy
                    parts2.append(len(shape.points))
                    part = []
                    for p in range(len(parts)):
                        points = []
                        _p = p + 1
                        for n in range(len(shape.points)):
                            if(n<parts2[_p] and n>=parts2[p]):
                                pt = shape.points[n]
                                points.append(list2point(pt))
                        
                        polylinecurve = rc.Geometry.PolylineCurve(points)
                        part.append(polylinecurve)
                    result_geom.append(part)
            
            if read_records:
                rec = shprecords[i]
                _result_records = []
                for r in range(len(sf.fields)):
                    if str(sf.fields[0][0]).startswith("DeletionFlag") and r==0:
                        continue
                    record = rec[r]
                    if(isinstance(record, str)):
                        record = record.decode(enc, errors="replace")
                    _result_records.append(record)
                result_records.append(_result_records)
                    
    return [sf.shapeType], result_geom, result_fields, result_field_names, result_records


path =py_tree(path)
if len(path.keys())==0:
    message = "Specify .shp file path"
    ghenv.Component.AddRuntimeMessage(ww, message)
else:
    read_geometry =py_tree(read_geometry, default=True)
    read_records =py_tree(read_records, default=True)
    enc =py_tree(enc, default="utf-8")
    
    _path, read_geometry = longest_list(path,read_geometry)
    _path, read_records = longest_list(path,read_records)
    _path, enc = longest_list(path,enc)
    
    path = graft_tree(path)
    read_geometry = graft_tree(read_geometry)
    read_records = graft_tree(read_records)
    enc = graft_tree(enc)
    
    out_shapeType = {}
    out_geometry = {}
    out_fields = {}
    out_field_names = {}
    out_records = {}
    
    for p,file_path in path.items():
    #    print(GH_Path(p), file_path[0],read_geometry[p][0],read_records[p][0],enc[p][0])
        _sf_type, _geom, _fields, _field_names, _records = read_shapefile(file_path[0],
                                                             read_geometry[p][0],
                                                             read_records[p][0],
                                                             enc[p][0])
        out_shapeType[p] = _sf_type
        out_geometry[p] = _geom
        out_fields[p] = _fields
        out_field_names[p] = _field_names
        out_records[p] = _records
    
    shape_type = py_tree(out_shapeType, reverse = True)
    geometry = py_tree(out_geometry, True)
    fields = py_tree(out_fields, True)
    field_names = py_tree(out_field_names, True)
    records = py_tree(out_records, True)
# ---------- end shp_import ----------
list_item = ListItem(List=shp_import.records, Index=Slider(1, range=0..10), Wrap=True)
unit_z = UnitZ(Factor=list_item)
move = Move(Geometry=shp_import.geometry, Motion=unit_z)  # -> Geometry, Transform
geometry = ClusterOutput(move.Geometry)
divide_length = DivideLength(Curve=move.Geometry, Length=Slider(5, range=0..10))  # -> Points, Tangents, Parameters
delaunay_mesh = DelaunayMesh(Points=flatten(divide_length.Points), Plane=PlaneXY(0, 0, 0))
qrmesh = QuadRemesh(Geometry=delaunay_mesh, Settings={aqc=True, as=50, dhe=True, gci=0, null=False, pme=2, sa=0, tqc=2000})
M = ClusterOutput(qrmesh)

# ==== cluster TopoMeshAnalysis
geometry = ClusterInput()
quad_remesh = QuadRemesh(Geometry=geometry, Settings={aqc=True, as=50, dhe=True, gci=0, null=False, pme=2, sa=0, tqc=2000})

# ---- group: explode mesh
c_script = CSharpScript(M=quad_remesh)  # -> out, F; inputs M: Mesh
# ---------- c_script: C# ----------
    List<Mesh> meshlist = new List<Mesh>();
    for (int i = 0; i <= M.Faces.Count - 1; i++) {
      //The MeshFace for each loop.
      MeshFace face = M.Faces[i];
      //The new mesh.
      Mesh newMesh = new Mesh();
      //Adding the vertex of face.
      newMesh.Vertices.Add(M.Vertices[face.A]);
      newMesh.Vertices.Add(M.Vertices[face.B]);
      newMesh.Vertices.Add(M.Vertices[face.C]);
      //Keep the colors.
      if (M.VertexColors.Count > 0) {
        newMesh.VertexColors.SetColor(0, M.VertexColors[face.A]);
        newMesh.VertexColors.SetColor(1, M.VertexColors[face.B]);
        newMesh.VertexColors.SetColor(2, M.VertexColors[face.C]);
      }
      //Adding the MeshFace.
      if ((face.IsTriangle)) {
        newMesh.Faces.AddFace(0, 1, 2);
      } else {
        newMesh.Vertices.Add(M.Vertices[face.D]);
        newMesh.Faces.AddFace(0, 1, 2, 3);
        if (M.VertexColors.Count > 0) {
          newMesh.VertexColors.SetColor(3, M.VertexColors[face.D]);
        }
      }
      //To list.
      meshlist.Add(newMesh);
    }
    F = meshlist;
# ---------- end c_script ----------

# ---- group: Measure angle
Z = UnitZ(Factor=1)
demesh = DeconstructMesh(Mesh=c_script.F)  # -> Vertices, Faces, Colours, Normals
angle = Angle(VectorA=demesh.Normals, VectorB=Z)  # -> Angle, Reflex

# ---- group: optimize by reducing values to evaluate
avr = Average(Input=angle.Angle)

# ---- group: Convert To Degrees
deg = Degrees(Radians=avr)

# ---- group: Convert to Percent
tan = Tangent(Value=avr)
multiplication = Multiplication(A="100", B=tan)

# ----
list = ValueList({"Degrees": 0, "Percent": 1}, selected="Percent")
genes = GenePool(Decimals=0, Maximum=300, Minimum=0, Value=[0, 3, 6, 9, 12, 15, 300])
filter = StreamFilter(Gate=list, Stream0=deg, Stream1=multiplication)

# ---- group: Find Values in Desired Domains
consec = ConsecutiveDomains(Numbers=genes, Additive=False)
lng = ListLength(List=consec)  # -> expr("x-1", Length)
fdom = FindDomain(Domains=consec, Number=filter, Strict=False)  # -> Index, Neighbour

# ---- group: Color by domain index value
gradient = Gradient(LowerLimit=0, UpperLimit=lng, Parameter=fdom.Index, stops=[0: RGB(0, 128, 0), 0.5: RGB(255, 255, 0), 1: RGB(255, 0, 0)])

# ---- group: Color by domain index value / Slope Zones
conmesh = ConstructMesh(Vertices=demesh.Vertices, Faces=demesh.Faces, Colours=gradient)

# ---- group: Blur Color After
mjoin = MeshJoin(Meshes=flatten(conmesh))
weld = WeldMesh(Mesh=mjoin, Angle=3.141592654)
mblur = BlurMesh(Mesh=weld, Iterations="1")
